# Grasshopper definition prueba2.gh (Grasshopper 1.0.7)
# plug-ins: Hops

location = GetString("40.403583784916066, -3.6040056502752686", AtLeast=1, AtMost=1, TreeAccess=False)
distance = GetInteger(Slider(1000, range=0..1000), AtLeast=1, AtMost=1, Maximum=2147483647, Minimum=-2147483648, TreeAccess=False)
hops = Hops(
    Location=location,
    Distance=distance,
    CacheResultsInMemory=True,
    CacheSolveResults=True,
    RemoteDefinitionLocation="http://127.0.0.1:5000/grapghs",
    RemoteSolveVersion=(0, 1, 0),
    ShowInput_Enabled=False,
    ShowInput_Path=False,
    SynchronousSolve=True)
