# Grasshopper definition pruebault.gh (Grasshopper 1.0.7)
# plug-ins: Bombyx 2, Hops

server = GetString("http://936a-34-125-61-94.ngrok.io", AtLeast=1, AtMost=1, TreeAccess=False)
play = GetInteger(Slider(0, range=0..5), AtLeast=1, AtMost=1, Maximum=2147483647, Minimum=-2147483648, TreeAccess=False)
location = GetString("40.403583784916066, -3.6040056502752686", AtLeast=1, AtMost=1, TreeAccess=False)
distance = GetInteger(Slider(1000, range=0..1000), AtLeast=1, AtMost=1, Maximum=2147483647, Minimum=-2147483648, TreeAccess=False)
concatenate = Concatenate(FragmentA=server, FragmentB="/grapghs")
hops = Hops(
    _Path=concatenate,
    Location=location,
    Distance=distance,
    CacheResultsInMemory=False,
    CacheSolveResults=False,
    RemoteDefinitionLocation="http://936a-34-125-61-94.ngrok.io/grapghs",
    RemoteSolveVersion=(0, 1, 0),
    ShowInput_Enabled=False,
    ShowInput_Path=True,
    SynchronousSolve=True)  # -> STREETS, BUILDINGS, HEIGHTS, SHAPE_DEM, WIDTHS, WIDTHS_DEVIATIONS, OPENNESS, Closeness400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

betweenness_metric_n = Data([0.01561355643, 0.02991122808, 0.02152497767, 0.01410049014, 0.01917489598, 0.04141616566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])
betweenness_metric_e = Data([0.01328761942, 0.004056305382, 0.01277253302, 0.01103411643, 0.01303007622, 0.03581460109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])
betweenness_metric_n_2 = Data([0.817079493, 0.8162856534, 0.8117303961, 0.820270362, 0.8217138932, 0.8153540906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])
widths_deviations = Data([0, 0, 0.0560165548, 0, 0, 4.113623393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])
closeness_global = Data([0.000958613587, 0.0009853568597, 0.0009991601367, 0.0009436240589, 0.0009470244364, 0.001008594399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])
closeness400 = Data([6.112429412e-05, 0.0001395186902, 7.928223269e-05, 0.0001243766502, 0.0001616430615, 0.0002670769767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])
shape_dem = Data([65, 85])
education = Data([0, 0, 0, 0, 0, 0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])
transport = Data([0, 0, 0, 0, 0, 0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])
buildings = Data([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])
openness = Data([1, 1, 0.7142857143, 1, 1, 0.2083333333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])
heights = Data([76.87145709, 90.9663379, 46.2343765, 56.89650102, 163.4392013, 165.0689203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])
streets = Data([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])
widths = Data([50, 50, 34.06880431, 50, 50, 19.91375202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])
speed = Data([50, 50, 30, 50, 30, 30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])
travel = Data([3.6, 2.2, 9.2, 2.6, 0.8, 14.9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])
food = Data([0, 0, 0, 0, 0, 0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])
shops = Data([0, 0, 0, 0, 0, 0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])

data = Data()
remap_numbers = RemapNumbers(Value=data, Source=Domain(0, 1), Target=Domain(0, 1))  # -> Mapped, Clipped
shape_dem_2 = Relay()
heights_2 = Relay()
buildings_2 = Relay()
streets_2 = Relay()
gradient = Gradient(
    LowerLimit=0,
    UpperLimit=1,
    Parameter=remap_numbers.Mapped,
    stops=[0: RGB(0, 128, 0), 0.5: RGB(255, 255, 0), 1: RGB(255, 0, 0)])
curvepoint = PointOnCurve(streets_2, parameter=0.5)
custom_preview = CustomPreview(Material=gradient)
cluster = Cluster(relay=streets_2, relay_2=heights_2, relay_3=shape_dem_2)  # -> flow_paths_short, flow_paths_long, terrain
prox = Proximity2D(Points=curvepoint, Plane=PlaneXY(0, 0, 0), Group="8")  # -> Links, Topology
lng = ListLength(List=streets_2)

# ----
# Visualise Curvas de nivel
number_slider = Slider(1, range=0..10)
terrain = Surface(cluster.terrain)
contour = Contour(Shape=terrain, Point=Point(0, 0, 0), Direction=Vector(0, 0, 1), Distance=number_slider)

lng_2 = ListLength(List=prox.Topology)  # -> flatten(Length)
# JACIN: GAME OF LIFE DE TODA LA VIDA CON LAS REGLAS DE CONWAY
# (el que se mueve más)
data_2 = Data(flatten(prox.Topology))
random = Random(Range=Domain(0, 1), Number=lng, Seed=2)
int = Integer(random)
item = ListItem(List=int, Index=prox.Topology, Wrap=True)
ma = MassAddition(Input=item)  # -> Result, PartialResults
cset = CreateSet(List=flatten(ma.Result))  # -> Set, Map

# ----
# REGULAR GAME OF LIFE
python = GhPythonScript(vals=flatten(int), neigh=data_2, neigh_len=lng_2, iterations="500")  # -> out, CA_vals; inputs vals: list of Int32, neigh: list of Int32, neigh_len: list of Int32, iterations: Int32
# ---------- python: Python ----------
__author__ = "pablom"
__version__ = "2022.08.10"


def neigh_game_of_life(data, neigh, chunks):
    neigh_data = [data[i] for i in neigh]
    it = iter(neigh_data)
    groups = [[next(it) for _ in range(chunk)] for chunk in chunks]
    av = [sum(group) for group in groups]
    
    return av

def game_of_life(vals, avvals): #nieghbours always 8
    
    new_vals = []
    
    for i in range(len(vals)):
        
        val = vals[i]
        av = avvals[i]
        
        if val == 0:
            if av == 3:
                val = 1
        
        elif av > 3 or av < 2:
                val = 0
        
        
        new_vals.append(val)
    
    return new_vals



CA_vals = [vals]

for i in range(iterations):
    
    new_av = neigh_game_of_life(CA_vals[i], neigh, neigh_len)
    new_vals = game_of_life(CA_vals[i], new_av)
    
    CA_vals.append(new_vals)
    
#print(CA_vals)
# ---------- end python ----------

colour_swatch = ColourSwatch(SwatchColor=RGB(148, 148, 148))
curve = Curve(contour)
custom_preview_2 = CustomPreview(Geometry=curve, Material=colour_swatch)

c_script = CSharpScript(crv=curve, color=colour_swatch)  # -> out, A; inputs crv: Curve, color: Color
# ---------- c_script: C# ----------
    var c = color.R + "," + color.G + "," + color.B;
    crv.SetUserString("color", c);
    A = crv;
# ---------- end c_script ----------
python_2 = GhPythonScript(x=python.CA_vals)  # -> out, a
# ---------- python_2: Python ----------
__author__ = "pablom"
__version__ = "2022.08.10"

a = x
# ---------- end python_2 ----------

# ---- group: RH_OUT:crv_nivel
curve_2 = Curve(c_script.A)

# ----
bnd = Bounds(Numbers=flatten(python_2.a))
panel = Panel(bnd)
series = Series(Start=0, Step=1, Count="500")
item_2 = ListItem(List=series, Index=play, Wrap=False)
concat = Concatenate(FragmentA="{", FragmentB=item_2, FragmentC="}")
num = Number(simplify(python_2.a))
branch = TreeBranch(Tree=num, Path=concat, MaintainPaths=True)
gradient_2 = Gradient(LowerLimit=0, UpperLimit=1, Parameter=branch, stops=[0: RGB(255, 0, 0), 1: RGB(0, 0, 255)])
colour_swatch_2 = ColourSwatch(SwatchColor=RGB(69, 69, 69))
c_script_2 = CSharpScript(crv=streets_2, color=gradient_2)  # -> out, A; inputs crv: Curve, color: Color; same code as c_script
c_script_3 = CSharpScript(crv=buildings_2, color=colour_swatch_2)  # -> out, A; inputs crv: Curve, color: Color; same code as c_script
preview = CustomPreview(Geometry=streets_2, Material=gradient_2)
preview_2 = CustomPreview(Geometry=buildings_2, Material=colour_swatch_2)

# ---- group: RH_OUT:crv_streets
curve_3 = Curve(c_script_2.A)

# ---- group: RH_OUT:crv_buildings
curve_4 = Curve(c_script_3.A)

# ==== cluster Cluster
relay = ClusterInput()
relay_2 = ClusterInput()
relay_3 = ClusterInput()
curve = Curve(relay)
list_item = ListItem(List=relay_3, Index=0, Wrap=True)  # -> Item1, Item
bounding_box = BoundingBox(Content=curve, Plane=PlaneXY(0, 0, 0), UnionBox=True)  # -> Box, Box_2
deconstruct_brep = DeconstructBrep(Brep=bounding_box.Box)  # -> Faces, Edges, Vertices
mesh_surface = MeshSurface(Surface=deconstruct_brep.Faces, UCount=list_item.Item1, VCount=list_item.Item, Overhang=True, Equalize=False)
face_boundaries = FaceBoundaries(Mesh=mesh_surface)
partition_list = PartitionList(List=face_boundaries, Size=list_item.Item)  # -> reverse(simplify(Chunks))
bounds = Bounds(Numbers=relay_2)
flip_matrix = FlipMatrix(Data=partition_list)  # -> flatten(Data)
remap_numbers = RemapNumbers(Value=relay_2, Source=bounds, Target=Domain(0, 1))  # -> Mapped, Clipped
partition_list_2 = PartitionList(List=flip_matrix, Size=list_item.Item1)  # -> simplify(Chunks)
area = Area(Geometry=partition_list_2)  # -> Area, Centroid
deconstruct = Deconstruct(Point=area.Centroid)  # -> XComponent, YComponent, ZComponent
partition_list_3 = PartitionList(List=remap_numbers.Mapped, Size=list_item.Item1)  # -> simplify(Chunks)
construct_point = ConstructPoint(XCoordinate=deconstruct.XComponent, YCoordinate=deconstruct.YComponent, ZCoordinate=expr("x*10", partition_list_3))
nurbs_curve = NurbsCurve(Vertices=construct_point, Degree=3, Periodic=False)  # -> Curve, Length, Domain
loft = Loft(
    Curves=flatten(nurbs_curve.Curve),
    Options={Adjust=False, Closed=False, LoftEnds=0, LoftSimp=0, LoftType=0, Rebuild=10, Refit=0.01})
number_slider = Slider(100, range=0..100)
# FLOWPATHS TERRAIN
number_slider_2 = Slider(0.5, range=0..1)
flow_paths = FlowPaths(Terrain=loft, Smooth=number_slider_2, UCount=number_slider, VCount=number_slider)  # -> FlowPathsShort, FlowPathsLong, Terrain
flow_paths_short = ClusterOutput(flow_paths.FlowPathsShort)
flow_paths_long = ClusterOutput(flow_paths.FlowPathsLong)
terrain = ClusterOutput(flow_paths.Terrain)
