# Grasshopper definition test.gh (Grasshopper 1.0.7)
# plug-ins: Bombyx 2

streets = Data([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])
play = GetInteger(Slider(0, range=0..5), AtLeast=1, AtMost=1, Maximum=2147483647, Minimum=-2147483648, TreeAccess=False)
curvepoint = PointOnCurve(streets, parameter=0.5)
prox = Proximity2D(Points=curvepoint, Plane=PlaneXY(0, 0, 0), Group="8")  # -> Links, Topology
lng = ListLength(List=streets)
lng_2 = ListLength(List=prox.Topology)  # -> flatten(Length)
# JACIN: GAME OF LIFE DE TODA LA VIDA CON LAS REGLAS DE CONWAY
# (el que se mueve más)
data = Data(flatten(prox.Topology))
random = Random(Range=Domain(0, 1), Number=lng, Seed=2)
int = Integer(random)
item = ListItem(List=int, Index=prox.Topology, Wrap=True)
ma = MassAddition(Input=item)  # -> Result, PartialResults
cset = CreateSet(List=flatten(ma.Result))  # -> Set, Map

# ----
# REGULAR GAME OF LIFE
python = GhPythonScript(vals=flatten(int), neigh=data, neigh_len=lng_2, iterations="500")  # -> out, CA_vals; inputs vals: list of Int32, neigh: list of Int32, neigh_len: list of Int32, iterations: Int32
# ---------- python: Python ----------
__author__ = "pablom"
__version__ = "2022.08.10"


def neigh_game_of_life(data, neigh, chunks):
    neigh_data = [data[i] for i in neigh]
    it = iter(neigh_data)
    groups = [[next(it) for _ in range(chunk)] for chunk in chunks]
    av = [sum(group) for group in groups]
    
    return av

def game_of_life(vals, avvals): #nieghbours always 8
    
    new_vals = []
    
    for i in range(len(vals)):
        
        val = vals[i]
        av = avvals[i]
        
        if val == 0:
            if av == 3:
                val = 1
        
        elif av > 3 or av < 2:
                val = 0
        
        
        new_vals.append(val)
    
    return new_vals



CA_vals = [vals]

for i in range(iterations):
    
    new_av = neigh_game_of_life(CA_vals[i], neigh, neigh_len)
    new_vals = game_of_life(CA_vals[i], new_av)
    
    CA_vals.append(new_vals)
    
#print(CA_vals)
# ---------- end python ----------

python_2 = GhPythonScript(x=python.CA_vals)  # -> out, a
# ---------- python_2: Python ----------
__author__ = "pablom"
__version__ = "2022.08.10"

a = x
# ---------- end python_2 ----------
bnd = Bounds(Numbers=flatten(python_2.a))
panel = Panel(bnd)
series = Series(Start=0, Step=1, Count="500")
item_2 = ListItem(List=series, Index=play, Wrap=False)
concat = Concatenate(FragmentA="{", FragmentB=item_2, FragmentC="}")
num = Number(simplify(python_2.a))
branch = TreeBranch(Tree=num, Path=concat, MaintainPaths=True)
gradient = Gradient(LowerLimit=0, UpperLimit=1, Parameter=branch, stops=[0: RGB(255, 0, 0), 1: RGB(0, 0, 255)])
c_script = CSharpScript(crv=streets, color=gradient)  # -> out, A; inputs crv: Curve, color: Color
# ---------- c_script: C# ----------
    var c = color.R + "," + color.G + "," + color.B;
    crv.SetUserString("color", c);
    A = crv;
# ---------- end c_script ----------
preview = CustomPreview(Geometry=streets, Material=gradient)

# ---- group: RH_OUT:crv_streets
curve = Curve(c_script.A)
